# Dynamo graph Schedules_les9.dyn (Dynamo 2.3.0.5885)

code_block = CodeBlock { "Тип"; }
code_block_2 = CodeBlock { ","; }
categories = Categories("OST_Rooms")
all_elements_of_category = ElementsOfCategory(Category=categories)
code_block_3 = CodeBlock { "Тип отделки"; }
getParameterValueByName = Element.GetParameterValueByName(element=all_elements_of_category, parameterName=code_block_3)
code_block_4 = CodeBlock(a=getParameterValueByName) { a != "(нет)"; }
filterByBoolMask = List.FilterByBoolMask(list=all_elements_of_category, mask=code_block_4)
getParameterValueByName_2 = Element.GetParameterValueByName(element=filterByBoolMask.in, parameterName=code_block_3)
code_block_5 = CodeBlock(a=getParameterValueByName_2) { a.Name; }
sortByKey = List.SortByKey(list=filterByBoolMask.in, keys=code_block_5)
groupByKey = List.GroupByKey(list=sortByKey.sorted_list, keys=sortByKey.sorted_keys)
code_block_6 = CodeBlock { "Номер"; }
getParameterValueByName_3 = Element.GetParameterValueByName(element=groupByKey.groups, parameterName=code_block_6)
join = String.Join(separator=code_block_2, string0=getParameterValueByName_3)
count = List.Count(list=groupByKey.groups@L2)
ofRepeatedItem = List.OfRepeatedItem(item=join@L1, amount=count@L1)
code_block_7 = CodeBlock(a=groupByKey.groups) { a; }
