# Dynamo graph ЧисткаВидов.dyn (Dynamo 2.0.2.6826)

file_path = Filename("..\Views_unused.py")
file_from_path = FileObject(path=file_path)
readText = FileSystem.ReadText(file=file_from_path)
boolean = BoolSelector(false)
python_script_from_string = PythonStringNode(script=readText, IN[0]=boolean)
type = Object.Type(obj=python_script_from_string)
count = List.Count(list=python_script_from_string@L2)
не_на_листах = CodeBlock(el=python_script_from_string) { treeD = el[0]; draftingView = el[1]; section = el[2]; floorPlan = el[3]; legend = el[4]; schedule = el[5]; }
code_block = CodeBlock(floorPlan=не_на_листах.floorPlan) { floorPlan; }
code_block_2 = CodeBlock { "Номер листа"; "Имя листа"; }
getParameterValueByName = Element.GetParameterValueByName(element=code_block, parameterName=code_block_2.out1)
code_block_3 = CodeBlock(treeD=не_на_листах.treeD) { treeD; }
code_block_4 = CodeBlock(draftingView=не_на_листах.draftingView) { draftingView; }
code_block_5 = CodeBlock(section=не_на_листах.section) { section; }
code_block_6 = CodeBlock(legend=не_на_листах.legend) { legend; }
code_block_7 = CodeBlock { schedule; }  # unwired: schedule
