# Dynamo graph DeleteSharedParameters.dyn (Dynamo 2.3.0.5885)
# packages: archi-lab.net 2023.213.1523

element_types = ElementTypes("SharedParameterElement")
all_elements_of_type = ElementsOfType(element_type=element_types)
delete = archilab.Revit.Elements.Elements.Delete(element=all_elements_of_type)  # frozen
element_types_2 = ElementTypes("ParameterElement")
all_elements_of_type_2 = ElementsOfType(element_type=element_types_2)
code_block = CodeBlock(a=all_elements_of_type_2) { a.Name; }
code_block_2 = CodeBlock { "BOS_"; }
contains = String.Contains(str=code_block, searchFor=code_block_2)
filterByBoolMask = List.FilterByBoolMask(list=all_elements_of_type_2, mask=contains)
delete_2 = archilab.Revit.Elements.Elements.Delete(element=filterByBoolMask.out)
code_block_3 = CodeBlock(a=filterByBoolMask.in) { a; }
