# Dynamo graph UNI_AssemblyCode.dyn (Dynamo 2.3.2.15696)

file_path = Filename(".\05.1_AssemblyCode_SetTypes.py")
file_from_path = FileObject(path=file_path)
readText = FileSystem.ReadText(file=file_from_path)
boolean = BoolSelector(false)
python_script_from_string = PythonStringNode(script=readText, IN[0]=boolean)
