# Dynamo graph UNI_AssemblyCodeFromExcel.dyn (Dynamo 2.3.2.15696)

path_to_excel = Filename(".\Коды по классификатору.xls")  # graph input
file_from_path = FileObject(path=path_to_excel)
sheet_name = StringInput("Стены")  # graph input
code_block = CodeBlock(filePath=file_from_path, sheetName=sheet_name)
# ---------- code_block.designscript (8 lines) ----------
file = DSOffice.Data.ImportExcel(filePath, sheetName, false, true);
data = List.Transpose(file);
codes = data[0];
types = data[2];
mask = codes != null;
f_codes = List.FilterByBoolMask(codes, mask)["in"];
f_types = List.FilterByBoolMask(types, mask)["in"];
Dictionary.ByKeysValues(f_types, f_codes);
# ----------------------------------------
python_script = Python(IN[0]=code_block.out7, IN[1]=sheet_name)
# ---------- python_script.python (45 lines) ----------
# -*- coding: utf-8 -*-
import clr
clr.AddReference("RevitAPI")
from Autodesk.Revit.DB import FilteredElementCollector, WallType, FloorType, CeilingType
clr.AddReference("RevitServices")
from RevitServices.Persistence import DocumentManager
from RevitServices.Transactions import TransactionManager
doc = DocumentManager.Instance.CurrentDBDocument
data = IN[0]
sheet_name = IN[1]


def get_all_types(document, elemType):
    return FilteredElementCollector(document).OfClass(elemType).ToElements()


def set_assembly_code(type_list, data):
    from Autodesk.Revit.DB import BuiltInParameter
    info = "UNDONE:("
    result = []
    for elem in type_list:
        name = elem.get_Parameter(BuiltInParameter.ALL_MODEL_TYPE_NAME).AsString()
        assembly_param = elem.get_Parameter(BuiltInParameter.UNIFORMAT_CODE)
        for key in data.keys():
            if name == key:
                value = data[key]
                if value == 999:
                    assembly_param.Set("999")
                else:
                    assembly_param.Set(value)
                info = "DONE:)"
        result.append("{} - {}".format(name, info))
    return result


TransactionManager.Instance.EnsureInTransaction(doc)
if sheet_name == "Стены":
    result = set_assembly_code(get_all_types(doc, WallType), data)
elif sheet_name == "Перекрытия":
    result = set_assembly_code(get_all_types(doc, FloorType), data)
elif sheet_name == "Потолок":
    result = set_assembly_code(get_all_types(doc, CeilingType), data)
TransactionManager.Instance.TransactionTaskDone()

OUT = result
# ----------------------------------------
code_block_2 = CodeBlock(result=python_script) { mask = String.Contains(result, ":(", false); List.FilterByBoolMask(result, mask)["in"]; }
