# Dynamo graph UNI_Rooms.Department.dyn (Dynamo 2.3.0.5885)

file_path = Filename("C:\Dynamo\08_UNIPRO\04_Rooms_Classification.py")
file_from_path = FileObject(path=file_path)
readText = FileSystem.ReadText(file=file_from_path)
categories = Categories("OST_Rooms")
all_elements_of_category = ElementsOfCategory(Category=categories)
code_block = CodeBlock(a=all_elements_of_category) { a.Name; }
sortByKey = List.SortByKey(list=all_elements_of_category, keys=code_block)
квартиры = CodeBlock { "Жильё"; "Квартиры"; }
python_script_from_string = PythonStringNode(script=readText, IN[0]=sortByKey.sorted_list, IN[1]=квартиры.out0)
code_block_2 = CodeBlock(a=python_script_from_string) { a.Name; }
code_block_3 = CodeBlock(a=python_script_from_string) { Element.GetParameterValueByName(a, "Department"); }
коммерческие_помещения = CodeBlock()
# ---------- коммерческие_помещения.designscript (4 lines) ----------
String.Split(
"БКТ,УНИВЕРСАЛЬНЫЙ МАГАЗИН,КАФЕ"
, ",");
"Коммерческие помещения";
# ----------------------------------------
технические = CodeBlock { "Техническ"; "Технические"; }
code_block_4 = CodeBlock { "СТСП_Тип помещения"; }
setParameterByName = Element.SetParameterByName(element=python_script_from_string, parameterName=code_block_4, value=квартиры.out1)
