# Dynamo graph toSTL.dyn (Dynamo 2.6.1.8786)

file_path = Filename(".\Assembly.py")
file_from_path = FileObject(path=file_path)
readText = FileSystem.ReadText(file=file_from_path)
boolean = BoolSelector(true)
python_script_from_string = PythonStringNode(script=readText, IN[0]=boolean)
