# Dynamo graph Загатовка.dyn (Dynamo 2.0.2.6826)

file_path = Filename("C:\Dynamo\Schedule_Create")
file_from_path = FileObject(path=file_path)
readText = FileSystem.ReadText(file=file_from_path)
категория = CodeBlock { "Окна"; }
code_block = CodeBlock { ["Высота", "Ширина", "Тип"]; }
python_script_from_string = PythonStringNode(script=readText, IN[0]=категория, IN[1]=code_block)
type = Object.Type(obj=python_script_from_string)
